# Grasshopper definition 150712 Curve lamp.gh (Grasshopper 0.9.76)

material_thickness = Slider(10, range=0..10)
int = Integer(Toggle(True))
crv = Curve(<curve referenced from the Rhino model>)
gate = StreamGate(Stream=Slider(12.5, range=0..100), Gate=int)  # -> Target0, Target1
neg = Negative(Value=gate.Target1)
offset = Offset(Curve=crv, Distance=[neg, gate.Target0], Plane=PlaneXY(0, 0, 0), Corners=1)
crv_2 = Curve(flatten([offset, crv]))
end = EndPoints(Curve=crv_2)  # -> Start, End
pt = Point(end.End)
pt_2 = Point(end.Start)
pdecon = Deconstruct(Point=pt)  # -> XComponent, YComponent, ZComponent
pdecon_2 = Deconstruct(Point=pt_2)  # -> XComponent, YComponent, ZComponent
sort = SortList(Keys=pdecon_2.ZComponent, ValuesA=pt_2, ValuesB=crv_2)  # -> Keys, ValuesA, ValuesB
sort_2 = SortList(Keys=pdecon.ZComponent, ValuesA=pt, ValuesB=crv_2)  # -> Keys, ValuesA, ValuesB
rev = ReverseList(List=sort_2.ValuesA)
rev_2 = ReverseList(List=sort.ValuesB)
rev_3 = ReverseList(List=sort_2.ValuesB)
item = ListItem(List=sort_2.ValuesB, Index=0, Wrap=True)
item_2 = ListItem(List=rev_2, Index=0, Wrap=True)
item_3 = ListItem(List=sort.ValuesA, Index=0, Wrap=True)
item_4 = ListItem(List=rev, Index=0, Wrap=True)
item_5 = ListItem(List=rev_3, Index=0, Wrap=True)
X = UnitX(Factor=1)
crv_3 = Curve(item)
X_2 = UnitX(Factor=1)
crv_4 = Curve(item_2)
neg_2 = Negative(Value=X)
neg_3 = Negative(Value=X_2)
project = ProjectPoint(Point=item_4, Direction=[X, neg_2], Geometry=crv_3)  # -> Point, Index
project_2 = ProjectPoint(Point=item_3, Direction=[neg_3, X_2], Geometry=crv_4)  # -> Point, Index
clean = CleanTree(RemoveNulls=True, RemoveInvalid=True, RemoveEmpty=False, Tree=project.Point)
clean_2 = CleanTree(RemoveNulls=True, RemoveInvalid=True, RemoveEmpty=False, Tree=project_2.Point)
end_2 = EndPoints(Curve=crv_3)  # -> Start, End
end_3 = EndPoints(Curve=crv_4)  # -> Start, End
ln = Line(StartPoint=item_4, EndPoint=clean)
ln_2 = Line(StartPoint=item_3, EndPoint=clean_2)
eval = Evaluate(F="if (x=y, z, u)", x=end_3.End, y=end_2.End, z="0", u="1")
ccx = CurveCurve(CurveA=ln, CurveB=crv_3)  # -> Points, ParamsA, ParamsB
ccx_2 = CurveCurve(CurveA=ln_2, CurveB=crv_4)  # -> Points, ParamsA, ParamsB
shatter = Shatter(Curve=crv_4, Parameters=ccx_2.ParamsB)
item_6 = ListItem(List=shatter, Index=Slider(1, range=0..10), Wrap=True)
filter = StreamFilter(Gate=eval, Stream0=item_6, Stream1=crv_3)
crv_5 = Curve(filter)
shatter_2 = Shatter(Curve=crv_5, Parameters=ccx.ParamsB)
filter_2 = StreamFilter(Gate=eval, Stream0=item_5, Stream1=item_6)
item_7 = ListItem(List=shatter_2, Index=Slider(0, range=0..10), Wrap=True)
crv_6 = Curve(flatten([ln_2, ln, item_7, filter_2]))
join = JoinCurves(Curves=crv_6, Preserve=False)
bbox = BoundingBox(Content=join, Plane=PlaneXY(0, 0, 0))  # -> Box, Box_2
debox = DeconstructBox(Box=bbox.Box)  # -> Plane, X, Y, Z
dedomain = DeconstructDomain(Domain=debox.X)  # -> Start, End
dedomain_2 = DeconstructDomain(Domain=debox.Z)  # -> Start, End
pt_3 = ConstructPoint(XCoordinate=dedomain.Start, YCoordinate=0, ZCoordinate=dedomain_2.Start)
X_3 = UnitX(Factor=Slider(100, range=0..100))
Z = UnitZ(Factor=1)
X_4 = UnitX(Factor=0)
ln_3 = Line(StartPoint=pt_3, EndPoint=X_3)
move = Move(Geometry=X_4, Motion=Z)  # -> Geometry, Transform
move_2 = Move(Geometry=join, Motion=ln_3)  # -> Geometry, Transform
ln_4 = Line(StartPoint=X_4, EndPoint=move.Geometry)
Y = UnitY(Factor=material_thickness)
extr = Extrude(Base=move_2.Geometry, Direction=Y)
dom = ConstructDomain(DomainStart=0, DomainEnd=Slider(360, range=0..360))
cap = CapHoles(Brep=extr)
range = Range(Domain=dom, Steps=Slider(30, range=0..30))
rad = Radians(Degrees=range)
rotax = RotateAxis(Geometry=cap, Angle=rad, Axis=ln_4)  # -> Geometry, Transform
